# Grasshopper definition data-generator.gh (Grasshopper 1.0.8)
# plug-ins: RhinoCodePluginGH, LunchBox

vector_xyz = VectorXYZ(XComponent=0, YComponent=0, ZComponent=0)  # -> Vector, Length
construct_domain = ConstructDomain(DomainStart=Slider(0.6, range=0..1), DomainEnd=Slider(1.3, range=0..10))
construct_domain_2 = ConstructDomain(DomainStart=Slider(0.6, range=0..1), DomainEnd=Slider(1.25, range=0..10))
point = Point(vector_xyz.Vector)
number_slider = Slider(1000, range=0..1000)
random = Random(Range=construct_domain_2, Number=1, Seed=2)
number_slider_2 = Slider(347, range=0..1300)
addition = Addition(A=number_slider_2, B=Slider(1000, range=0..1000))
random_2 = Random(Range=construct_domain, Number=1, Seed=addition)
rectangle = Rectangle(Plane=point, XSize=number_slider, YSize=number_slider, Radius=0)  # -> Rectangle, Length
random_quad_panels = RandomQuadPanels(
    Surface=rectangle.Rectangle,
    UDivisions=Slider(15, range=0..100),
    VDivisions=Slider(70, range=0..100),
    RandomSeed=number_slider_2)
area = Area(Geometry=rectangle.Rectangle)  # -> Area, Centroid
construct_domain_3 = ConstructDomain(DomainStart=Slider(0.55, range=0..1), DomainEnd=Slider(0.95, range=0..1))
random_3 = Random(Range=construct_domain_3, Number=1, Seed=number_slider_2)
scale_nu = ScaleNU(Geometry=rectangle.Rectangle, Plane=area.Centroid, ScaleX=random, ScaleY=random_2, ScaleZ=1)  # -> Geometry, Transform
populate_2d = Populate2D(Region=scale_nu.Geometry, Count=Slider(250, range=0..1000), Seed=number_slider_2)
voronoi = Voronoi(Points=populate_2d, Boundary=scale_nu.Geometry, BruteForceOverride=False)
list_length = ListLength(List=voronoi)
multiplication = Multiplication(A=list_length, B=random_3)
random_reduce = RandomReduce(List=voronoi, Reduction=multiplication, Seed=number_slider_2)
construct_domain_4 = ConstructDomain(DomainStart=Slider(60, range=0..100), DomainEnd=Slider(250, range=0..1000))
construct_domain_5 = ConstructDomain(DomainStart=Slider(20, range=0..100), DomainEnd=Slider(60, range=0..1000))
construct_domain_6 = ConstructDomain(DomainStart=Slider(5, range=0..100), DomainEnd=Slider(20, range=0..1000))
list_length_2 = ListLength(List=random_reduce)
boundary_surfaces = BoundarySurfaces(Edges=scale_nu.Geometry)
python_3_script = Python3Script(x=number_slider_2, L=construct_domain_6, M=construct_domain_5, H=construct_domain_4)  # -> out
# ---------- python_3_script: Python ----------
if x <= 200:
    print(L)
elif 200 < x <= 400:
    print(M)
elif x > 400:
    print(H)
# ---------- end python_3_script ----------
random_4 = Random(Range=python_3_script, Number=list_length_2, Seed=number_slider_2)
integer = Integer(random_4)
unit_z = UnitZ(Factor=integer)
extrude = Extrude(Base=random_reduce, Direction=unit_z)
cap_holes = CapHoles(Brep=extrude)
mesh_brep = MeshBrep(
    Brep=cap_holes,
    Settings={GridMaxCount=0, GridMinCount=16, JaggedSeams=False, MaxEdgeLength=0, MinEdgeLength=0.0001, MinTolerance=0, Refine=True, RefineAngle=0, RelativeTolerance=0.65, SimplePlanes=True, Tolerance=0})  # -> flatten(Mesh)
mesh_join = MeshJoin(Meshes=mesh_brep)
panel = Panel("https://climate.onebuilding.org/WMO_Region_4_North_and_Central_America/CAN_Canada/ON_Ontario/CAN_ON_Toronto-Pearson.Intl.AP.716240_TMYx.zip")
epwmap = LBEPWmap(epw_map=Toggle(False))  # -> Output; plug-in component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
deconstruct_mesh = DeconstructMesh(Mesh=mesh_join)  # -> Vertices, Faces, Colours, Normals
number_slider_3 = Slider(12, range=0..100)
number_slider_4 = Slider(21, range=0..100)
downloadepw = LBDownloadWeather(weather_URL=panel)  # -> epw_file, stat_file, ddy_file; plug-in component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
deconstruct = Deconstruct(Point=deconstruct_mesh.Vertices)  # -> XComponent, YComponent, ZComponent
importepw = LBImportEPW(epw_file=downloadepw.epw_file)  # -> location, dry_bulb_temperature, dew_point_temperature, relative_humidity, wind_speed, wind_direction, direct_normal_rad, diffuse_horizontal_rad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; plug-in component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
analysisperiod = LBAnalysisPeriod(
    start_month=number_slider_3,
    start_day=number_slider_4,
    start_hour=Slider(8, range=0..10),
    end_month=number_slider_3,
    end_day=number_slider_4,
    end_hour=Slider(16, range=0..100),
    timestep=Slider(1, range=0..1))  # -> period, hoys, dates; plug-in component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
construct_domain_7 = ConstructDomain(DomainStart=Slider(60, range=0..100), DomainEnd=Slider(255, range=0..1000))
construct_domain_8 = ConstructDomain(DomainStart=Slider(0, range=0..100), DomainEnd=Slider(250, range=0..1000))
remap_numbers = RemapNumbers(Value=deconstruct.ZComponent, Source=construct_domain_8, Target=construct_domain_7)  # -> Mapped, Clipped
sunpath = LBSunPath(location=importepw.location, hoys=analysisperiod.hoys, scale=1)  # -> out, vectors, altitudes, azimuths, hoys, sun_pts, analemma, daily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; plug-in component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
number_slider_5 = Slider(240, range=0..1000)
merge = Merge(Data1=boundary_surfaces, Data2=cap_holes)  # -> flatten(Result)
gradient = Gradient(
    LowerLimit=Slider(0, range=0..100),
    UpperLimit=Slider(255, range=0..1000),
    Parameter=remap_numbers.Mapped,
    stops=[0: RGB(255, 255, 255), 1: RGB(0, 0, 0)])
legendpar = LBLegendParameters(min=Slider(0, range=0..100), max=Slider(10, range=0..10))  # -> leg_par; plug-in component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
mesh_brep_2 = MeshBrep(
    Brep=merge,
    Settings={GridMaxCount=0, GridMinCount=16, JaggedSeams=False, MaxEdgeLength=0, MinEdgeLength=0.0001, MinTolerance=0, Refine=True, RefineAngle=0, RelativeTolerance=0.65, SimplePlanes=True, Tolerance=0})
colour_rgb = ColourRGB(Alpha=255, Red=number_slider_5, Green=number_slider_5, Blue=number_slider_5)
mesh_join_2 = MeshJoin(Meshes=mesh_brep_2)
directsunhours = LBDirectSunHours(
    vectors=flatten(sunpath.vectors),
    geometry=flatten(merge),
    context=flatten(merge),
    grid_size=Slider(5, range=0..10),
    offset_dist=Slider(0.2, range=0..1),
    legend_par=legendpar,
    run=Toggle(False))  # -> out, points, results, mesh, legend, title, int_mtx; plug-in component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
mesh_brep_3 = MeshBrep(
    Brep=boundary_surfaces,
    Settings={GridMaxCount=0, GridMinCount=16, JaggedSeams=False, MaxEdgeLength=0, MinEdgeLength=0.0001, MinTolerance=0, Refine=True, RefineAngle=0, RelativeTolerance=0.65, SimplePlanes=True, Tolerance=0})
python_3_script_2 = Python3Script(x=mesh_join_2, y=Toggle(False))  # -> out, a; inputs x: Mesh, y: Boolean
# ---------- python_3_script_2: Python ----------
import clr
import System.Net
import System.Text
import Rhino
import json

# --- 配置 ---
# 这是我们后端的地址
url = "http://127.0.0.1:8000/sync_model"

def sync_mesh(rhino_mesh):
    """提取 Mesh 数据并发送给后端"""
    if rhino_mesh is None:
        return "错误: 请连接一个 Mesh"
        
    # 1. 提取顶点 (Vertices) -> [x,y,z, x,y,z...]
    verts = []
    for v in rhino_mesh.Vertices:
        # Rhino 的坐标直接发过去，前端会负责旋转坐标轴
        verts.append(v.X)
        verts.append(v.Y)
        verts.append(v.Z)
        
    # 2. 提取面 (Faces) -> [a,b,c, a,c,d...]
    faces = []
    for f in rhino_mesh.Faces:
        if f.IsQuad: # 如果是四边面，切成两个三角形
            faces.extend([f.A, f.B, f.C])
            faces.extend([f.A, f.C, f.D])
        else: # 三角面
            faces.extend([f.A, f.B, f.C])
            
    # 3. 构造 JSON Payload
    payload = {
        "vertices": verts,
        "faces": faces
    }
    
    # 4. 发送 POST 请求
    try:
        json_data = json.dumps(payload)
        client = System.Net.WebClient()
        client.Headers.Add("Content-Type", "application/json")
        # 发送！
        response = client.UploadString(url, "POST", json_data)
        return "模型同步成功! (顶点数: {})".format(len(verts)/3)
    except Exception as e:
        return "同步失败: " + str(e)

# --- 入口 ---
# x: 输入的 Mesh
# y: 输入的 Button (布尔值)

msg = "等待同步..."

# 只有当按钮按下 (True) 且模型存在时才运行
if y is True and x is not None:
    msg = sync_mesh(x)

print(msg)
a = msg
# ---------- end python_3_script_2 ----------
python_3_script_3 = Python3Script(buildings=mesh_join, ground=mesh_brep_3, preview=Toggle(False), send=Toggle(False))  # -> out, a; inputs buildings: list of Mesh, ground: list of Mesh, preview: Boolean, send: Boolean
# ---------- python_3_script_3: Python ----------
import Rhino
import System.Drawing
import System.Net
import System.IO
import scriptcontext as sc
import rhinoscriptsyntax as rs

# ==========================================
# 全局配置
# ==========================================
url = "http://127.0.0.1:8000/predict"

safe_temp_dir = System.IO.Path.GetTempPath()
temp_filename = "gh_auto_capture.png"
temp_path = System.IO.Path.Combine(safe_temp_dir, temp_filename)

PREVIEW_TAG = "InstantSim_Preview_Geometry"

# --- 缩放边距系数 (越大边距越宽) ---
# 1.2 代表留出 20% 的空隙，防止贴边
ZOOM_FACTOR = 1.2 

# --- 建筑颜色 (0-195) ---
BUILDING_H_MIN = 0.0    
BUILDING_H_MAX = 250.0  
COLOR_AT_BOTTOM = 195   
COLOR_AT_TOP = 0        

# --- 地面颜色 (固定 240) ---
COLOR_GROUND = 240      

# --- 背景颜色 (固定 255) ---
COLOR_BACKGROUND = 255  
# ==========================================

def create_colored_meshes(building_meshes, ground_meshes):
    meshes_out = []
    # 这个 bbox 只包含建筑和地面，不包含背景板
    bbox = Rhino.Geometry.BoundingBox.Empty

    # 1. 地面
    if ground_meshes:
        if not isinstance(ground_meshes, list): ground_meshes = [ground_meshes]
        ground_color = System.Drawing.Color.FromArgb(COLOR_GROUND, COLOR_GROUND, COLOR_GROUND)
        for g_mesh in ground_meshes:
            if g_mesh and g_mesh.IsValid:
                temp_g = g_mesh.DuplicateMesh()
                temp_g.VertexColors.CreateMonotoneMesh(ground_color)
                temp_g.Normals.ComputeNormals() 
                temp_g.UserDictionary.Set("Tag", PREVIEW_TAG)
                meshes_out.append(temp_g)
                bbox.Union(temp_g.GetBoundingBox(True))

    # 2. 建筑
    if building_meshes:
        if not isinstance(building_meshes, list): building_meshes = [building_meshes]
        joined_buildings = Rhino.Geometry.Mesh()
        for b_mesh in building_meshes:
            if b_mesh and b_mesh.IsValid: 
                joined_buildings.Append(b_mesh)
                bbox.Union(b_mesh.GetBoundingBox(True))
            
        if joined_buildings.IsValid:
            colors = []
            for v in joined_buildings.Vertices:
                z = v.Z
                if z < BUILDING_H_MIN: z = BUILDING_H_MIN
                if z > BUILDING_H_MAX: z = BUILDING_H_MAX
                t = (z - BUILDING_H_MIN) / (BUILDING_H_MAX - BUILDING_H_MIN)
                gray_val = int(COLOR_AT_BOTTOM + t * (COLOR_AT_TOP - COLOR_AT_BOTTOM))
                colors.append(System.Drawing.Color.FromArgb(gray_val, gray_val, gray_val))
            
            joined_buildings.VertexColors.Clear()
            for c in colors: joined_buildings.VertexColors.Add(c)
            joined_buildings.Normals.ComputeNormals()
            joined_buildings.UserDictionary.Set("Tag", PREVIEW_TAG)
            meshes_out.append(joined_buildings)

    # 3. 背景板 (无限大，但不影响 bbox 计算)
    if meshes_out: 
        safe_z = bbox.Min.Z - 50.0 
        bg_plane = Rhino.Geometry.Mesh.CreateFromPlane(
            Rhino.Geometry.Plane.WorldXY, 
            Rhino.Geometry.Interval(-50000, 50000), 
            Rhino.Geometry.Interval(-50000, 50000), 
            10, 10
        )
        bg_plane.Translate(Rhino.Geometry.Vector3d(0, 0, safe_z))
        bg_plane.VertexColors.CreateMonotoneMesh(System.Drawing.Color.FromArgb(COLOR_BACKGROUND, COLOR_BACKGROUND, COLOR_BACKGROUND))
        bg_plane.Normals.ComputeNormals()
        bg_plane.UserDictionary.Set("Tag", PREVIEW_TAG)
        meshes_out.insert(0, bg_plane)

    return meshes_out, bbox

def clear_previous_previews():
    sc.doc = Rhino.RhinoDoc.ActiveDoc
    try:
        all_objects = sc.doc.Objects.FindByObjectType(Rhino.DocObjects.ObjectType.Mesh)
        ids_to_delete = []
        for obj in all_objects:
            if obj.Geometry.UserDictionary.GetString("Tag") == PREVIEW_TAG:
                ids_to_delete.append(obj.Id)
        
        if len(ids_to_delete) > 0:
            for id in ids_to_delete:
                sc.doc.Objects.Delete(id, True)
            sc.doc.Views.Redraw()
            return True
        return False
    finally:
        sc.doc = ghdoc 

def action_preview(b_meshes, g_meshes):
    clear_previous_previews()
    
    meshes, bbox = create_colored_meshes(b_meshes, g_meshes)
    if not meshes: return "数据无效"

    sc.doc = Rhino.RhinoDoc.ActiveDoc 
    try:
        sc.doc.Views.RedrawEnabled = False
        for m in meshes:
            sc.doc.Objects.AddMesh(m)
            
        view = sc.doc.Views.Find("Top", False)
        if view:
            sc.doc.Views.ActiveView = view
            vp = view.ActiveViewport
            
            rendered = Rhino.Display.DisplayModeDescription.FindByName("Rendered")
            if rendered: vp.DisplayMode = rendered
            
            # 核心修改：强制正方形缩放算法
            if bbox.IsValid:
                center = bbox.Center
                dx = bbox.Max.X - bbox.Min.X
                dy = bbox.Max.Y - bbox.Min.Y
                
                # 找出最长的一边
                max_dim = max(dx, dy)
                
                # 创建一个新的、正方形的虚拟包围盒
                # 边长 = 最长边 * 缩放系数 (1.2)
                half_side = (max_dim * ZOOM_FACTOR) / 2.0
                
                target_bbox = Rhino.Geometry.BoundingBox(
                    center.X - half_side, center.Y - half_side, center.Z,
                    center.X + half_side, center.Y + half_side, center.Z
                )
                
                # 让相机对准这个完美的正方形
                vp.ZoomBoundingBox(target_bbox)
            
        return "预览开启 (智能居中)"
    finally:
        sc.doc.Views.RedrawEnabled = True
        sc.doc.Views.Redraw()
        sc.doc = ghdoc 

def action_send(b_meshes, g_meshes):
    msg = action_preview(b_meshes, g_meshes)
    if "x" in msg: return msg

    sc.doc = Rhino.RhinoDoc.ActiveDoc
    try:
        view = sc.doc.Views.Find("Top", False)
        if not view: return "请打开 Top 视图"
        
        sc.doc.Views.Redraw()
        System.Windows.Forms.Application.DoEvents() 
        
        capture = Rhino.Display.ViewCapture()
        capture.Width = 512
        capture.Height = 512
        capture.ScaleScreenItems = False
        capture.DrawGrid = False
        capture.DrawAxes = False
        capture.TransparentBackground = False 
        
        bitmap = capture.CaptureToBitmap(view)
        
        if bitmap is None: return "截图失败"

        bitmap.Save(temp_path, System.Drawing.Imaging.ImageFormat.Png)
        
        if not System.IO.File.Exists(temp_path): return "保存失败"
        
        client = System.Net.WebClient()
        response = client.UploadFile(url, "POST", temp_path)
        
        return "发送成功!"
        
    except Exception as e:
        return "错误: " + str(e)
    finally:
        sc.doc = ghdoc

# --- 消息逻辑 ---
if "last_msg" not in sc.sticky:
    sc.sticky["last_msg"] = "等待指令..."

if send:
    sc.sticky["last_msg"] = action_send(buildings, ground)
elif preview:
    sc.sticky["last_msg"] = action_preview(buildings, ground)
else:
    did_delete = clear_previous_previews()
    if did_delete:
        sc.sticky["last_msg"] = "预览已关闭"

msg = sc.sticky["last_msg"]
print(msg)
# ---------- end python_3_script_3 ----------
mesh_colours = MeshColours(Mesh=mesh_brep_3, Colours=colour_rgb)
mesh_colours_2 = MeshColours(Mesh=mesh_join, Colours=gradient)
mesh = Mesh(directsunhours.mesh)
panel_2 = Panel(python_3_script_2.a)
panel_3 = Panel(directsunhours.results)
panel_4 = Panel(python_3_script_3.out)
